# Grasshopper definition rd_mesh.gh (Grasshopper 1.0.7)
# plug-ins: HAL for Grasshopper, Kangaroo2 Components, LunchBoxML, MeshEdit Components

# ---- group: Mesh ball Blank
number_slider = Slider(63, range=0..100)  # disabled
number_slider_2 = Slider(50, range=0..100)  # disabled
msphere = MeshSphere(Base=PlaneXY(0, 0, 0), Radius=number_slider, UCount=number_slider_2, VCount=number_slider_2)  # disabled
number_slider_3 = Slider(50, range=0..100)  # disabled
number_slider_4 = Slider(2, range=0..10)  # disabled
triremesh = TriRemesh(Geometry=msphere, Length=number_slider_4, Iterations=number_slider_3)  # -> Triangulation, Dual, Creases; disabled

# ---- group: Current Dir
python = GhPythonScript()  # -> out, a
# ---------- python: Python ----------
import rhinoscriptsyntax as rs

file_name = ghenv.Component.OnPingDocument().FilePath

print(file_name)
# ---------- end python ----------
panel = Panel(python.out)

# ----
number_slider_5 = Slider(6, range=0..10)  # disabled

# ---- group: Twisted Shade/ Method 2
mesh = Mesh(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)

# ---- group: remesh by color (K2)
mesh_2 = Mesh(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)

# ---- group: Mesh Ball (6seed)
mesh_3 = Mesh(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)

# ---- group: simple_vase_open_low_res_2
mesh_4 = Mesh(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)  # disabled

# ----
panel_2 = Panel(mesh)
sessionsettings = SessionSettings()
triremesh_2 = TriRemesh(Geometry=mesh_4, Length=number_slider_5, Iterations=number_slider_3)  # -> Triangulation, Dual, Creases; disabled
mesh_5 = Mesh(mesh)
demesh = DeconstructMesh(Mesh=mesh_5)  # -> Vertices, Faces, Colours, Normals

# ---- group: get edge length avg
explode = MeshExplode(Mesh=mesh_5, Interpolate=False)
faceb = FaceBoundaries(Mesh=explode)  # -> flatten(Boundaries)
len = Length(Curve=faceb)
avr = Average(Input=len)
division = Division(A=avr, B="3")

# ---- group: get mesh verticies neighbors / Mesh
# Find Only Nearest Neighbors (much less effiecient)
dam = DataDam(DataA=mesh_5, BufferDelay=10000000, BufferMode=0)

# ---- group: get mesh verticies neighbors
demesh_2 = DeconstructMesh(Mesh=dam)  # -> Vertices, Faces, Colours, Normals
lng = ListLength(List=demesh_2.Vertices)
series = Series(Start=0, Step=1, Count=lng)
vn = VertexNeighbours(Mesh=dam, VertexNumber=series)  # -> Vertex, Neighbours, Normal
mindex = MemberIndex(Set=demesh_2.Vertices, Member=vn.Neighbours)  # -> Index, Count
mindex_2 = MemberIndex(Set=demesh_2.Vertices, Member=vn.Vertex)  # -> flatten(Index), Count
trim = TrimTree(Tree=mindex.Index, Depth=1)  # -> simplify(Tree)

# ----
rtree = CreateRTree(InputGeometry=demesh.Vertices)

# ---- group: Test Nearest Neighbors
number_slider_6 = Slider(100, range=0..100)
number_slider_7 = Slider(1000, range=0..1000)
tstat = TreeStatistics(Tree=trim)  # -> Paths, Length, Count
item = ListItem(List=tstat.Paths, Index=number_slider_7, Wrap=True)
item_2 = ListItem(List=mindex_2.Index, Index=number_slider_7, Wrap=True)
branch = TreeBranch(Tree=trim, Path=item, MaintainPaths=True)
item_3 = ListItem(List=demesh_2.Vertices, Index=item_2, Wrap=True)
item_4 = ListItem(List=demesh_2.Vertices, Index=branch, Wrap=True)

# ---- group: get convolution groups / Edge length (rough avg)
mesh_len_scaler = Slider(3.5, range=1..5)
num = Number(division)
multiplication = Multiplication(A=num, B=mesh_len_scaler)

# ---- group: get convolution groups
mesh_len_scaler_2 = Slider(1.5, range=0.1..2)
num_2 = Number(division)
multiplication_2 = Multiplication(A=num_2, B=mesh_len_scaler_2)

# *result should only include nearest neighbors
number_slider_8 = Slider(8, range=0..100)
lng_2 = ListLength(List=demesh.Vertices)
series_2 = Series(Start=0, Step=1, Count=lng_2)
popgeo = PopulateGeometry(Geometry=mesh_5, Count=number_slider_8, Seed=1)
item_5 = ListItem(List=demesh.Vertices, Index=series_2, Wrap=True)
rtree_range = RTreePointsInRange(SearchPoints=popgeo, SearchDistance=multiplication, RTree=rtree)  # -> PointsWithinRange, IndicesWithinRange
rtree_range_2 = RTreePointsInRange(SearchPoints=item_5, SearchDistance=multiplication_2, RTree=rtree)  # -> PointsWithinRange, IndicesWithinRange

# ---- group: get mesh verticies neighbors / Mesh Convolution
# laplace_indices
# Neighbors
int = Integer(simplify(graft(mindex_2.Index)))
int_2 = Integer(trim)
merge = Merge(Data1=int, Data2=int_2)

# ---- group: convolution_indices
int_3 = Integer(simplify(merge))

# ---- group: seed
int_4 = Integer(rtree_range.IndicesWithinRange)

# ---- group: Avg # of convolution indices
viewer = ParamViewer(int_3)
lng_3 = ListLength(List=int_3)  # -> flatten(Length)
avr_2 = Average(Input=lng_3)

# ----
tstat_2 = TreeStatistics(Tree=rtree_range_2.PointsWithinRange)  # -> Paths, Length, Count

# ---- group: Write Json
python_2 = GhPythonScript(Dump=Button(), Pts=demesh.Vertices, conv_indices=int_3, S=flatten(int_4))  # -> out; inputs Dump: Boolean, Pts: list of Point3d, conv_indices: tree of Int32, S: list of Int32
# ---------- python_2: Python ----------
#https://stackoverflow.com/questions/25924244/creating-2d-dictionary-in-python

import rhinoscriptsyntax as rs
import json
import Grasshopper as gh
import ghpythonlib.treehelpers as th

##1D dict structure EXAMPLE
#sample_dict = {'pts':{}}
#sample_dict['pts']['pt'] = {'X': 1.5, 'Y': 2.5, 'Z': 3.5}
##print(sample_dict)
#
##2D dict structure EXAMPLE
#sample_2Ddict = {'pts':[]}
#sample_2Ddict['pts'].append({'pt': {'X': 1.5, 'Y': 2.5, 'Z': 3.5}})
##print(sample_2Ddict)

output = {}

#convert to list of list
ci_list = []
for i in range(conv_indices.BranchCount):
    branchList = conv_indices.Branch(i)
    branchPath = conv_indices.Path(i)
    ci_list.append([])
    for j in range(branchList.Count):
        ci_list[i].append(branchList[j])
        
#make dictionary
ci_dict = {'convolution_indices':[]}
for i in range(len(ci_list)):
    ci_dict['convolution_indices'].append([])
    for j in range(len(ci_list[i])):
        ci_dict['convolution_indices'][i].append(ci_list[i][j])
output.update(ci_dict)

#add seed
seed_dict = {'seed_indices':[]}
for i in S:
    seed_dict['seed_indices'].append(i)
output.update(seed_dict)

if Dump:
    with open(r"C:\Users\Prinz\Desktop\Projects\ISF\reaction_diffusion_repo\rd_existing_mesh\data\existing_mesh_data.json", 'w') as f:
        json.dump(output, f, indent=4)
        f.close()
        print("json updated")

print("see existing_mesh_data.json")
# ---------- end python_2 ----------
panel_3 = Panel(python_2)

# ---- group: should read atleast 6
panel_4 = Panel(avr_2)

# ----
item_6 = ListItem(List=tstat_2.Paths, Index=Slider(145, range=0..1000), Wrap=True)
branch_2 = TreeBranch(Tree=rtree_range_2.PointsWithinRange, Path=item_6, MaintainPaths=True)

# ---- group: Open Json
path = FilePath("C:\Users\Prinz\Desktop\Projects\ISF\reaction_diffusion_repo\rd_existing_mesh\data\results.json")
python_3 = GhPythonScript(FilePath=path)  # -> out, vertex_values
# ---------- python_3: Python ----------
import rhinoscriptsyntax as rs
import json

# Opening JSON file
f = open(FilePath)
  
# returns JSON object as a dictionary
data = json.load(f)

vertex_values = data['vertex_values']
# ---------- end python_3 ----------

# ----
rgb = ColourRGB(Alpha=255, Red=python_3.vertex_values, Green=python_3.vertex_values, Blue=python_3.vertex_values)
mcol = MeshColours(Mesh=mesh_5, Colours=rgb)
cloud = CloudDisplay(Points=demesh.Vertices, Colours=rgb, Size=Slider(2.3, range=0..10), SpriteType=0)

# ---- group: Color Mesh
dom = ConstructDomain(DomainStart="0", DomainEnd="255")
dom_2 = ConstructDomain(DomainStart=Slider(0, range=0..100), DomainEnd=Slider(217, range=0..1000))
remap = RemapNumbers(Value=python_3.vertex_values, Source=dom, Target=dom_2)  # -> Mapped, Clipped
int_5 = Integer(remap.Mapped)
rgb_2 = ColourRGB(Alpha=255, Red=int_5, Green=int_5, Blue=int_5)

# ---- group: 10k iterations
mesh_6 = Mesh(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)

# ---- group: reduced post displacement
mesh_7 = Mesh(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)

# ---- group: Twisted_Bowl_variable_mesh_length
mesh_8 = Mesh(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)

# ---- group: Offset Pts
number_slider_9 = Slider(1.4, range=0..10)
dom_3 = ConstructDomain(DomainStart="0", DomainEnd="255")

# ----
neg = Negative(Value=number_slider_9)

# ---- group: Offset Pts (continued)
dom_4 = ConstructDomain(DomainStart=neg, DomainEnd=number_slider_9)
remap_2 = RemapNumbers(Value=python_3.vertex_values, Source=dom_3, Target=dom_4)  # -> Mapped, Clipped
amp = Amplitude(Vector=demesh.Normals, Amplitude=remap_2.Mapped)
move = Move(Geometry=demesh.Vertices, Motion=amp)  # -> simplify(Geometry), Transform

# ---- group: Make Mesh
conmesh = ConstructMesh(Vertices=flatten(move.Geometry), Faces=demesh.Faces)
mcol_2 = MeshColours(Mesh=conmesh, Colours=rgb_2)
